# Grasshopper definition 2d-pixel-formfinder.gh (Grasshopper 0.9.76)
# plug-ins: Python Interpreter, HDTReference

geo = Geometry(<curve referenced from the Rhino model>)
bbox = BoundingBox(Content=geo, Plane=PlaneXY(0, 0, 0))  # -> Box, Box_2
eval = EvaluateCurve(Curve=geo, Parameter=Slider(0, range=0..100))  # -> Point, Tangent, Angle
geo_2 = Geometry(geo)
debrep = DeconstructBrep(Brep=bbox.Box)  # -> Faces, Edges, Vertices
item = ListItem(List=debrep.Vertices, Index=0, Wrap=True)
geo_3 = Geometry(geo_2)
num = Number(Slider(5, range=1..10))
crv_cp = CurveClosestPoint(Point=item, Curve=geo_2)  # -> Point, Parameter, Distance
cluster = Cluster_2(P=crv_cp.Point, num=num)
# algorithm 2 (DON'T WORK AT ALL)
python = PythonScript()  # -> allPts
# ---------- python: Python ----------
import rhinoscriptsyntax as rs
import math

allPts = []

def roundPt(param):
    
    if param <= rs.CurveLength(curve):
        
        pt = rs.EvaluateCurve(curve, param)
    
        x = unit * round(pt[0] / unit)
        y = unit * round(pt[1] / unit)
        z = unit * round(pt[2] / unit)
        
        rounded = (x, y, z)
        rounded = rs.coerce3dpoint(rounded)
        
        if not rounded in allPts:
            
            allPts.append(rounded)
            
        roundPt(param + unit)


roundPt(0)
# ---------- end python ----------
python_2 = PythonScript(curve=geo_3, start=cluster, unit=num)  # -> allPts
# ---------- python_2: Python ----------
import rhinoscriptsyntax as rs

dirs = [
    [0, unit, 0],
    [unit, 0, 0],
    [0, -unit, 0],
    [-unit, 0, 0]
]

next = False
allPts = []
allPts.append(start)

def move(pt, lastPt):
    
    pt = rs.coerce3dpoint(pt)
    
    distances = []
    movedpts = []
    
    for dir in dirs:
        
        moved = rs.PointAdd(pt, dir)
        movedpt = rs.coerce3dpoint(moved)
        
        # don't check against the last point, 
        # and don't check against any former points
        if movedpt != lastPt and not movedpt in allPts:
            movedpts.append(moved)
        
    for m in movedpts:
        
        closestParam = rs.CurveClosestPoint(curve, m)
        closest = rs.EvaluateCurve(curve, closestParam)
        dist = rs.Distance(closest, m)
        distances.append(dist)
        
    # if all of the possible distances are greater
    # than the unit size, then we have left the curve,
    # so wrap up
    far = 0
    for d in distances:
        if d > unit:
            far += 1
    if far == len(distances):
        return
        
    closestIndex = findSmallestItemIndex(distances)
    
    next = movedpts[closestIndex]
    allPts.append(next)
    move(next, pt)
    
def findSmallestItemIndex(items):
    if items:
        least = 1000000
        i = 0
        for i, item in enumerate(items):
            if item < least:
                least = item
                index = i
            i = i + 1
        return index

next = move(start, False)
# ---------- end python_2 ----------
panel = Panel("algorithm 1")
geo_4 = Geometry(python)
number_slider = Slider(0.5, range=0..1)
geo_5 = Geometry(python_2)
pline = PolyLine(Vertices=geo_4, Closed=False)
pline_2 = PolyLine(Vertices=geo_5, Closed=False)
flip = FlipCurve(Curve=pline_2)  # -> Curve, Flag
offset = Offset(Curve=flip.Curve, Distance=number_slider, Plane=PlaneXY(0, 0, 0), Corners=1)
offset_2 = Offset(Curve=pline_2, Distance=number_slider, Plane=PlaneXY(0, 0, 0), Corners=1)
geo_6 = Geometry(offset_2)
geo_7 = Geometry(offset)
previewlw = CustomPreviewLineweights(Geometry=[geo_6, geo_7], Shader=ColourSwatch(SwatchColor=RGB(255, 255, 255)), Thickness=Slider(2.5, range=0..10))

# ==== cluster Cluster_2
num = ClusterInput()
P = ClusterInput()
num_2 = Number(num)
pdecon = Deconstruct(Point=P)  # -> XComponent, YComponent, ZComponent
cluster = Cluster(A=pdecon.XComponent, num=num_2)
cluster_2 = Cluster(A=pdecon.YComponent, num=num_2)
cluster_3 = Cluster(A=pdecon.ZComponent, num=num_2)
pt = ConstructPoint(XCoordinate=cluster, YCoordinate=cluster_2, ZCoordinate=cluster_3)
pt_2 = ClusterOutput(pt)

# ==== cluster Cluster
num = ClusterInput()
A = ClusterInput()
num_2 = Number(num)
division = Division(A=A, B=num_2)
round = Round(Number=division)  # -> Nearest, Floor, Ceiling
multiplication = Multiplication(A=round.Nearest, B=num_2)
R = ClusterOutput(multiplication)
