# Grasshopper definition cubemaker.gh (Grasshopper 0.9.76)
# plug-ins: Python Interpreter, HDTReference

number_slider = Slider(1000000, range=0..1000000)
panel = Panel("ridiculously high")
number_slider_2 = Slider(25, range=0..25)
panel_2 = Panel("UNIT SIZE")
multiplication = Multiplication(A=number_slider, B=-1)
Z = UnitZ(Factor=multiplication)
Z_2 = UnitZ(Factor=number_slider)
pt = ConstructPoint(XCoordinate=0, YCoordinate=0, ZCoordinate=0)
X = UnitX(Factor=number_slider)
geo = Geometry(<brep referenced from the Rhino model>)
X_2 = UnitX(Factor=multiplication)
move = Move(Geometry=pt, Motion=Z)  # -> Geometry, Transform
move_2 = Move(Geometry=pt, Motion=Z_2)  # -> Geometry, Transform
move_3 = Move(Geometry=pt, Motion=X)  # -> Geometry, Transform
move_4 = Move(Geometry=pt, Motion=X_2)  # -> Geometry, Transform
num = Number(number_slider)
panel_3 = Panel("lowest point")
brep_cp = BrepClosestPoint(Point=move.Geometry, Brep=geo)  # -> Point, Distance
brep_cp_2 = BrepClosestPoint(Point=move_2.Geometry, Brep=geo)  # -> Point, Distance
dist = Distance(PointA=brep_cp.Point, PointB=brep_cp_2.Point)
num_2 = Number(number_slider_2)
division = Division(A=num, B=2)
division_2 = Division(A=dist, B=num_2)
series = Series(Start=0, Step=num_2, Count=division_2)
geo_2 = Geometry(brep_cp.Point)
multiplication_2 = Multiplication(A=division, B=-1)
num_3 = Number(number_slider_2)
geo_3 = Geometry(move_4.Geometry)
geo_4 = Geometry(move_3.Geometry)
Z_3 = UnitZ(Factor=series)
Y = UnitY(Factor=multiplication_2)
X_3 = UnitX(Factor=multiplication_2)
move_5 = Move(Geometry=geo_2, Motion=Z_3)  # -> Geometry, Transform
addition = Addition(A=X_3, B=Y)
pl = ConstructPlane(Origin=move_5.Geometry, XAxis=Vector(1, 0, 0), YAxis=Vector(0, 1, 0))
planesrf = PlaneSurface(Plane=pl, XSize=num, YSize=num)
move_6 = Move(Geometry=planesrf, Motion=addition)  # -> Geometry, Transform
python = PythonScript(geo=geo, planes=move_6.Geometry)  # -> out, curves; inputs planes: list
# ---------- python: Python ----------
import rhinoscriptsyntax as rs

curves = []

if geo and planes:
    
    for plane in planes:
        
        curve = rs.IntersectBreps(geo, plane)
        curve = rs.coerceguid(curve)
        
        if curve and rs.IsCurve(curve):
            
            curvegeo = rs.coercegeometry(curve)
            curves.append(curvegeo)
# ---------- end python ----------
# section curves over height
geo_5 = Geometry(python.curves)
previewlw = CustomPreviewLineweights(Geometry=geo_5, Shader=ColourSwatch(SwatchColor=RGB(17, 117, 240)), Thickness=Slider(3, range=0..10))
crv_cp = CurveClosestPoint(Point=geo_4, Curve=geo_5)  # -> Point, Parameter, Distance
crv_cp_2 = CurveClosestPoint(Point=geo_3, Curve=geo_5)  # -> Point, Parameter, Distance
pdecon = Deconstruct(Point=crv_cp.Point)  # -> XComponent, YComponent, ZComponent
pdecon_2 = Deconstruct(Point=crv_cp_2.Point)  # -> XComponent, YComponent, ZComponent
num_4 = Number(num_3)
cluster = Cluster(A=pdecon_2.XComponent, A_2=pdecon_2.YComponent, A_3=pdecon_2.ZComponent, num=num_4)  # -> R, R_2, R_3
cluster_2 = Cluster(A=pdecon.XComponent, A_2=pdecon.YComponent, A_3=pdecon.ZComponent, num=num_4)  # -> R, R_2, R_3
pt_2 = ConstructPoint(XCoordinate=cluster.R, YCoordinate=cluster.R_2, ZCoordinate=pdecon_2.ZComponent)
pt_3 = ConstructPoint(XCoordinate=cluster_2.R, YCoordinate=cluster_2.R_2, ZCoordinate=pdecon.ZComponent)
y_line_thru_pt = YLineThruPt(geo=pt_2)
crv_cp_3 = CurveClosestPoint(Point=pt_3, Curve=y_line_thru_pt)  # -> Point, Parameter, Distance
ln = Line(StartPoint=pt_3, EndPoint=crv_cp_3.Point)
dist_2 = Distance(PointA=pt_3, PointB=crv_cp_3.Point)
geo_6 = Geometry(geo_5)
# number of steps for rectangular subdivision
division_3 = Division(A=dist_2, B=num_4)
division_4 = Division(A=num_4, B=2)
divide = DivideCurve(Curve=ln, Count=division_3, Kinks=False)  # -> Points, Tangents, Parameters
num_5 = Number(num_4)
X_4 = UnitX(Factor=division_4)
# can safely flatten since we only check for intersections
y_line_thru_pt_2 = YLineThruPt(geo=divide.Points)  # -> flatten(L)
move_7 = Move(Geometry=y_line_thru_pt_2, Motion=X_4)  # -> Geometry, Transform
python_2 = PythonScript(curves=geo_6, lines=move_7.Geometry)  # -> out, intersections; inputs curves: list, lines: list
# ---------- python_2: Python ----------
import rhinoscriptsyntax as rs

intersections = []

for curve in curves:
    
    for line in lines:
        
        if rs.CurveCurveIntersection(curve, line):
            
            int = rs.CurveCurveIntersection(curve, line)
            
            if len(int) % 2 == 0 and len(int) > 0:
                
                for pt in int:
                    
                    intersections.append(pt[1])
# ---------- end python_2 ----------
geo_7 = Geometry(flatten(python_2.intersections))
python_3 = PythonScript(pts=geo_7)  # -> start, end; inputs pts: list
# ---------- python_3: Python ----------
i = 0
start = []
end = []
ordered = []

for pt in pts:
    
    if i % 2 == 0:
        start.append(pt)
    else:
        end.append(pt)
 
    i += 1
# ---------- end python_3 ----------
num_6 = Number(num_5)
pdecon_3 = Deconstruct(Point=python_3.start)  # -> XComponent, YComponent, ZComponent
pdecon_4 = Deconstruct(Point=python_3.end)  # -> XComponent, YComponent, ZComponent
X_5 = UnitX(Factor=num_6)
round_to_nearest_n = RoundToNearestN(A=pdecon_3.YComponent, num=num_6)
round_to_nearest_n_2 = RoundToNearestN(A=pdecon_4.YComponent, num=num_6)
pt_4 = ConstructPoint(XCoordinate=pdecon_3.XComponent, YCoordinate=round_to_nearest_n, ZCoordinate=pdecon_3.ZComponent)
pt_5 = ConstructPoint(XCoordinate=pdecon_4.XComponent, YCoordinate=round_to_nearest_n_2, ZCoordinate=pdecon_4.ZComponent)
multiplication_3 = Multiplication(A=num_6, B=Slider(-0.5, range=-2..1))
ln_2 = Line(StartPoint=pt_4, EndPoint=pt_5)
Z_4 = UnitZ(Factor=num_5)
extr = Extrude(Base=ln_2, Direction=X_5)
extr_2 = Extrude(Base=extr, Direction=Z_4)
X_6 = UnitX(Factor=multiplication_3)
cap = CapHoles(Brep=extr_2)
move_8 = Move(Geometry=cap, Motion=X_6)  # -> Geometry, Transform
preview = CustomPreview(Geometry=move_8.Geometry, Shader=ColourSwatch(SwatchColor=RGB(209, 209, 209)))

# ==== cluster Cluster
num = ClusterInput()
num_2 = Number(num)
A = ClusterInput()
A_2 = ClusterInput()
A_3 = ClusterInput()
round_to_nearest_n = RoundToNearestN(A=A, num=num_2)
round_to_nearest_n_2 = RoundToNearestN(A=A_2, num=num_2)
round_to_nearest_n_3 = RoundToNearestN(A=A_3, num=num_2)
R = ClusterOutput(round_to_nearest_n)
R_2 = ClusterOutput(round_to_nearest_n_2)
R_3 = ClusterOutput(round_to_nearest_n_3)

# ==== cluster YLineThruPt
number_slider = Slider(1000000, range=0..1000000)
geo = ClusterInput()
geo_2 = Geometry(geo)
multiplication = Multiplication(A=number_slider, B=-1)
Y = UnitY(Factor=number_slider)
Y_2 = UnitY(Factor=multiplication)
move = Move(Geometry=geo_2, Motion=Y)  # -> Geometry, Transform
move_2 = Move(Geometry=geo_2, Motion=Y_2)  # -> Geometry, Transform
ln = Line(StartPoint=move.Geometry, EndPoint=move_2.Geometry)
L = ClusterOutput(ln)

# ==== cluster RoundToNearestN
num = ClusterInput()
A = ClusterInput()
num_2 = Number(num)
division = Division(A=A, B=num_2)
round = Round(Number=division)  # -> Nearest, Floor, Ceiling
multiplication = Multiplication(A=round.Nearest, B=num_2)
R = ClusterOutput(multiplication)
