# Grasshopper definition cubemaker2.gh (Grasshopper 0.9.76)
# plug-ins: Python Interpreter

geo = Geometry(<brep referenced from the Rhino model>)
geo_2 = Geometry(geo)
bbox = BoundingBox(Content=geo_2, Plane=PlaneXY(0, 0, 0))  # -> Box, Box_2
debrep = DeconstructBrep(Brep=bbox.Box)  # -> Faces, Edges, Vertices
sort_pt = SortPoints(Points=debrep.Vertices)  # -> Points, Indices
lng = ListLength(List=sort_pt.Points)
subtraction = Subtraction(A=lng, B=1)
item = ListItem(List=sort_pt.Points, Index=0, Wrap=True)
item_2 = ListItem(List=sort_pt.Points, Index=subtraction, Wrap=True)
geo_3 = Geometry(geo_2)
panel = Panel("""point w/ greatest
x, y, z""")
panel_2 = Panel("""point w/ least 
x, y, z""")
num = Number(Slider(5, range=3..10))
geo_4 = Geometry(item)
geo_5 = Geometry(item_2)
pdecon = Deconstruct(Point=geo_5)  # -> XComponent, YComponent, ZComponent
pdecon_2 = Deconstruct(Point=geo_4)  # -> XComponent, YComponent, ZComponent
panel_3 = Panel("-1")
panel_4 = Panel("height")
subtraction_2 = Subtraction(A=pdecon.ZComponent, B=pdecon_2.ZComponent)
division = Division(A=subtraction_2, B=num)
multiplication = Multiplication(A="0.5", B=num)
geo_6 = Geometry(geo_3)
round_to_nearest_n = RoundToNearestN()
series = Series(Start=0, Step=num, Count=division)
addition = Addition(A=series, B=multiplication)
geo_7 = Geometry(geo_4)
Z = UnitZ(Factor=addition)
move = Move(Geometry=geo_7, Motion=Z)  # -> Geometry, Transform
pdecon_3 = Deconstruct(Point=move.Geometry)  # -> XComponent, YComponent, ZComponent
python = PythonScript(geo=geo_6, heights=pdecon_3.ZComponent)  # -> intersections; inputs heights: list
# ---------- python: Python ----------
import rhinoscriptsyntax as rs

intersections = []

if geo and heights:
    
    for height in heights:
        
        plane = rs.PlaneFromPoints((-1000000, -1000000, height), (0, -1000000, height), (-1000000, 1000000, height))
        srf = rs.AddPlaneSurface(plane, 2000000, 2000000)
        
        int = rs.IntersectBreps(geo, srf)
        int = rs.coercegeometry(int)
        
        intersections.append(int)
# ---------- end python ----------
geo_8 = Geometry(python)

# ==== cluster RoundToNearestN
num = ClusterInput()
A = ClusterInput()
num_2 = Number(num)
division = Division(A=A, B=num_2)
round = Round(Number=division)  # -> Nearest, Floor, Ceiling
multiplication = Multiplication(A=round.Nearest, B=num_2)
R = ClusterOutput(multiplication)
