# Grasshopper definition scale-wip.gh (Grasshopper 0.9.76)

number_slider = Slider(2, range=0..10)
multiplication = Multiplication(A=number_slider, B=-1)
feet_to_inches = FeetToInches(input=multiplication)
feet_to_inches_2 = FeetToInches(input=Slider(5, range=0..10))
feet_to_inches_3 = FeetToInches(input=Slider(17, range=0..100))
feet_to_inches_4 = FeetToInches(input=Slider(12, range=0..100))
pt = ConstructPoint(XCoordinate=0, YCoordinate=0, ZCoordinate=0)
Y = UnitY(Factor=feet_to_inches)
X = UnitX(Factor=feet_to_inches_2)
rectangle = Rectangle(Plane=PlaneXY(0, 0, 0), XSize=feet_to_inches_3, YSize=feet_to_inches_4, Radius=0)  # -> Rectangle, Length
feet_to_inches_5 = FeetToInches(input=number_slider)
move = Move(Geometry=pt, Motion=Y)  # -> Geometry, Transform
move_2 = Move(Geometry=move.Geometry, Motion=X)  # -> Geometry, Transform
Y_2 = UnitY(Factor=feet_to_inches_5)
move_3 = Move(Geometry=move_2.Geometry, Motion=Y_2)  # -> Geometry, Transform
move_4 = Move(Geometry=move_3.Geometry, Motion=X)  # -> Geometry, Transform
pline = PolyLine(Vertices=[pt, move.Geometry, move_2.Geometry, move_3.Geometry, move_4.Geometry], Closed=False)

# ==== cluster FeetToInches
list = ValueList({"Inches": True, "Feet": False}, selected="Feet")
input = ClusterInput()
python = PythonScript(inches=list, input=input)  # -> output
# ---------- python: Python ----------
# if model base unit is in inches,
# do nothing
if inches:
    output = input
# if feet, divide by 12
else:
    output = input / 12
# ---------- end python ----------
output = ClusterOutput(python)
