# Grasshopper definition stairmaker.gh (Grasshopper 0.9.76)
# plug-ins: Python Interpreter

pipeline = GeometryPipeline(
    GroupByLayer=False,
    GroupByType=False,
    IncludeHidden=True,
    IncludeLocked=True,
    LayerFilter="3dStairs",
    NameFilter="*",
    TypeFilter=4)
geo = Geometry(pipeline)
geo_2 = Geometry(geo)
end = EndPoints(Curve=geo_2)  # -> Start, End
xz = XZPlane(Origin=end.End)
project = Project(Geometry=geo_2, Plane=xz)  # -> Geometry, Transform
xy = XYPlane(Origin=end.End)
panel = Panel("Riser height (7\" max)")
project_2 = Project(Geometry=geo_2, Plane=xy)  # -> Geometry, Transform
len = Length(Curve=project.Geometry)
division = Division(A=len, B=Slider(0.583, range=0..1))
divide = DivideCurve(Curve=project_2.Geometry, Count=division, Kinks=False)  # -> Points, Tangents, Parameters
divide_2 = DivideCurve(Curve=geo_2, Count=division, Kinks=False)  # -> Points, Tangents, Parameters
python = PythonScript(heights=divide_2.Points)  # -> a; inputs heights: list
# ---------- python: Python ----------
for i, h in enumerate(heights):
    if i == 0:
        heights.remove(h)
a = heights
# ---------- end python ----------
item = ListItem(List=divide.Points, Index=Slider(0, range=0..100), Wrap=True)
item_2 = ListItem(List=divide.Points, Index=Slider(1, range=0..1), Wrap=True)
subtraction = Subtraction(A=item, B=item_2)
vec = Vector(subtraction)
geo_3 = Geometry(python)
move = Move(Geometry=geo_3, Motion=vec)  # -> Geometry, Transform
ln = Line(StartPoint=move.Geometry, EndPoint=geo_3)
end_2 = EndPoints(Curve=ln)  # -> Start, End
rotate = Rotate(Geometry=ln, Center=end_2.End, From=Vector(1, 0, 0), To=Vector(0, 1, 0))  # -> Geometry, Transform
end_3 = EndPoints(Curve=rotate.Geometry)  # -> Start, End
subtraction_2 = Subtraction(A=end_3.Start, B=end_2.End)
vlen = VectorLength(Vector=subtraction_2)
panel_2 = Panel("stair tread 2\" deep")
division_2 = Division(A=Slider(6, range=0..10), B=vlen)
multiplication = Multiplication(A=subtraction_2, B=division_2)
vec_2 = Vector(multiplication)
extr = Extrude(Base=ln, Direction=vec_2)
Z = UnitZ(Factor=Slider(-0.167, range=-1..1))
extr_2 = Extrude(Base=extr, Direction=Z)
